# Dynamo graph Paraboloide_Midi.dyn (Dynamo 2.17.1.4055)

zero = TimeSpan.Zero()
now = DateTime.Now()
timeOfDay = DateTime.TimeOfDay(dateTime=now)
add = TimeSpan.Add(timeSpan1=zero, timeSpan2=timeOfDay)
revit_uia = Python(IN[0]=add)  # CPython3
# ---------- revit_uia.python (20 lines) ----------
import clr
import Revit

clr.AddReference("ProtoGeometry")
clr.AddReference("RevitAPI")
clr.AddReference("RevitAPIUI")
clr.AddReference("RevitServices")
clr.AddReference("RevitNodes")

from Autodesk.DesignScript.Geometry import *
from Autodesk.Revit.DB import *
from RevitServices.Persistence import DocumentManager


dad = IN[0]

doc = DocumentManager.Instance.CurrentDBDocument
uia = DocumentManager.Instance.CurrentUIApplication

OUT = uia
# ----------------------------------------
code_block = CodeBlock { 0; }
MIDI_Ativar = Musica_2020.Musica_2020.MIDI_Ativar(n=code_block)
toca_0_ou_1 = IntegerSlider(1, range=0..1 step 1)
instrumentos_1_a_128 = IntegerSlider(11, range=0..128 step 1)
toca_paraboloide = CodeBlock(rvuia=revit_uia, tempo=add, midi=MIDI_Ativar, toca=toca_0_ou_1, inst=instrumentos_1_a_128)
# ---------- toca_paraboloide.designscript (48 lines) ----------
rvuia;
tempo;
midi;
toca;
inst;
//---------------------------------------------------------
// Converte em string o Tempo Atual e separa segs e mils
// Configurar o período compatível com a duração
//---------------------------------------------------------
min  = 7;
mili = String.Substring ( tempo+"" , 9 , 3);
s    = (String.ToNumber ( mili ) % min )+min;
x    = (0..s);
y    = (0..s);
z1   = (0..s);
z2   = (s..0);
pt = Point.ByCoordinates ( x<1> , y , 0);
i  = 0..s-1;
j  = i+1;
p1 = pt[ 0].Translate    ( 0 , 0 , z1);
p2 = pt[-1].Translate    ( 0 , 0 , z2);
pp = Line.DivideEqually  ( g1  ,  s).StartPoint;

g1 = Line.ByStartPointEndPoint ( p1    , p2);
g2 = Line.ByStartPointEndPoint ( p1[i] , p1[j]);
g3 = Line.ByStartPointEndPoint ( p2[i] , p2[j]);
g4 = Line.ByStartPointEndPoint ( pp[i] , pp[j]);

e  = [
         [  0 ,   5,  1,  3,   9, 4, 8,  5, 4,  7] ,
         [  1 ,  -5, -1, -3,  -9, 2, 6, -5, 4, -7] ,
         [ -2 ,  -6, -2, -9, -11, 4, 8, -6, 4, -8]
      ];
//---------------------------------------------------------
// Se aumentar a dur deve aumentar o período para que possa
// completar o ciclo
//---------------------------------------------------------
esc = e[(s%2)?0:(s%3)?1:2];
n   = List.Count(esc)-1;
alt = Math.Floor( pp.Z )%n;
fun = s%4?60:s%3?56:72;
not = fun+esc[alt];
dur = Math.Floor (5500 / Math.Pow( s+1 , 1.5));
din = 127;
//---------------------------------------------------------
// Tocar --------------------------------------------------
//---------------------------------------------------------
Musica_2020.Tocar_Nota( midi, not, dur, din, 1, 9, toca);
# ----------------------------------------
